# Grasshopper definition Example.gh (Grasshopper 1.0.8)
# plug-ins: GhChatbot

panel = Panel("You are a repeat machine. Repeat every thing user said to you.")
local_llm_chatbot = LocalLLMChatbot(LocalLLMEndpoint="http://localhost:1234/v1/chat/completions", SystemPrompt=panel, ClearDialog=Button())  # -> Status, Dialog
panel_2 = Panel(local_llm_chatbot.Dialog)
panel_3 = Panel(local_llm_chatbot.Status)
