# Grasshopper definition Example.gh (Grasshopper 1.0.8)
# plug-ins: GhChatbot

local_llm_chatbot = LocalLLMChatbot(
    LocalLLMEndpoint="http://localhost:1234/v1/chat/completions",
    SystemPrompt="If user say hey, just say: Please try again",
    ClearDialog=Button())  # -> Status, Dialog
panel = Panel(local_llm_chatbot.Status)
panel_2 = Panel(local_llm_chatbot.Dialog)
